# Grasshopper definition AULA_04.gh (Grasshopper 0.9.76)

# Slider Float
number_slider = Slider(10, range=0..100)
# Slider INT
number_slider_2 = Slider(1, range=0..100)
# Slider INT
number_slider_3 = Slider(10, range=0..100)
# Slider INT
number_slider_4 = Slider(10, range=0..100)
# Slider Float
number_slider_5 = Slider(10, range=0..100)
# Selecione Ponto(s)
point = Point()
point_2 = Point()
# Aula 04 - Listas
# Selecione Curva(s)
curve = Curve()
curve_2 = Curve()
# Versor Z
unit_z = UnitZ(Factor=1)
# Versor Z
unit_z_2 = UnitZ(Factor=1)
# Move Objetos
move = Move(Motion=Vector(0, 0, 10))  # -> Geometry, Transform
# Move Objetos
move_2 = Move(Motion=Vector(0, 0, 10))  # -> Geometry, Transform
circle = Circle(Plane=PlaneXY(0, 0, 0), Radius=1)
# Cria Círculo
circle_2 = Circle(Plane=PlaneXY(0, 0, 0), Radius=1)
# Divide Curvas
divide_curve = DivideCurve(Count=10, Kinks=False)  # -> Points, Tangents, Parameters
divide_curve_2 = DivideCurve(Count=10, Kinks=False)  # -> Points, Tangents, Parameters
divide_curve_3 = DivideCurve(Count=10, Kinks=False)  # -> Points, Tangents, Parameters
# Divide Curvas
divide_curve_4 = DivideCurve(Count=10, Kinks=False)  # -> Points, Tangents, Parameters
# Slider Float
number_slider_6 = Slider(10, range=0..100)
# Slider Float
number_slider_7 = Slider(10, range=0..100)
# Lista de pontos
point_list = PointList(Size=number_slider_6)
point_list_2 = PointList(Size=number_slider_6)
# Lista de pontos
point_list_3 = PointList(Size=number_slider_7)
point_list_4 = PointList(Size=number_slider_7)
# Slider INT
number_slider_8 = Slider(1, range=0..100)
# Shift list
shift_list = ShiftList(Shift=1, Wrap=True)
# Cria Linha
# Entre 2 Pontos
line = Line()
# Cria Linha
# Entre 2 Pontos
line_2 = Line()
# Cria Tubo
pipe = Pipe(Radius=1, Caps=0)
# Cria Tubo
pipe_2 = Pipe(Radius=1, Caps=0)
# Cap
cap_holes = CapHoles()
# Cap
cap_holes_2 = CapHoles()
