# Grasshopper definition AULA_04_FINAL.gh (Grasshopper 0.9.76)

# Slider Float
number_slider = Slider(10, range=0..100)
# Slider Float
number_slider_2 = Slider(11.536, range=0..100)
# Slider INT
number_slider_3 = Slider(32, range=0..100)
# Slider Float
number_slider_4 = Slider(25.872, range=0..100)
# Slider INT
number_slider_5 = Slider(10, range=0..100)
# Selecione Ponto(s)
point = Point(<point referenced from the Rhino model>)
# Selecione Curva(s)
curve = Curve(<curve referenced from the Rhino model>)
# Aula 04 - Listas
panel = Panel(curve)
# Versor Z
unit_z = UnitZ(Factor=number_slider_2)
# Versor Z
unit_z_2 = UnitZ(Factor=number_slider_4)
# Move Objetos
move = Move(Geometry=point, Motion=unit_z)  # -> Geometry, Transform
# Move Objetos
move_2 = Move(Geometry=curve, Motion=unit_z_2)  # -> Geometry, Transform
# Cria Círculo
circle = Circle(Plane=point, Radius=number_slider)
circle_2 = Circle(Plane=move.Geometry, Radius=number_slider)
# Divide Curvas
divide_curve = DivideCurve(Curve=curve, Count=10, Kinks=False)  # -> Points, Tangents, Parameters
divide_curve_2 = DivideCurve(Curve=move_2.Geometry, Count=10, Kinks=False)  # -> Points, Tangents, Parameters
divide_curve_3 = DivideCurve(Curve=circle_2, Count=number_slider_3, Kinks=False)  # -> Points, Tangents, Parameters
# Divide Curvas
divide_curve_4 = DivideCurve(Curve=circle, Count=number_slider_3, Kinks=False)  # -> Points, Tangents, Parameters
# Slider Float
number_slider_6 = Slider(2.136, range=0..100)
# Slider Float
number_slider_7 = Slider(4.102, range=0..100)
panel_2 = Panel(divide_curve.Points)
# Lista de pontos
point_list = PointList(Points=divide_curve_4.Points, Size=number_slider_6)
# Lista de pontos
point_list_2 = PointList(Points=divide_curve.Points, Size=number_slider_7)
point_list_3 = PointList(Points=divide_curve_2.Points, Size=number_slider_7)
# Slider INT
number_slider_8 = Slider(4, range=0..100)
# Shift list
shift_list = ShiftList(List=divide_curve_3.Points, Shift=number_slider_8, Wrap=True)
number_slider_9 = Slider(0.49, range=0..10)
# Cria Linha
# Entre 2 Pontos
line = Line(StartPoint=divide_curve_4.Points, EndPoint=shift_list)
# Cria Linha
# Entre 2 Pontos
line_2 = Line(StartPoint=divide_curve.Points, EndPoint=divide_curve_2.Points)
point_list_4 = PointList(Points=shift_list, Size=number_slider_6)
# Cria Tubo
pipe = Pipe(Curve=line, Radius=number_slider_9, Caps=0)
# Cria Tubo
pipe_2 = Pipe(Curve=line_2, Radius=number_slider_9, Caps=0)
panel_3 = Panel(pipe_2)
# Cap
cap_holes = CapHoles(Brep=pipe)
# Cap
cap_holes_2 = CapHoles(Brep=pipe_2)
