# Grasshopper definition aula_04_2018_1_FINAL.gh (Grasshopper 0.9.76)

curve = Curve(<curve referenced from the Rhino model>)
divide_curve = DivideCurve(Curve=curve, Count=Slider(8, range=0..50), Kinks=False)  # -> Points, Tangents, Parameters
point = Point(divide_curve.Points)
unit_z = UnitZ(Factor=Slider(22.952, range=0..100))
panel = Panel(divide_curve.Points)
panel_2 = Panel(point)
move = Move(Geometry=point, Motion=unit_z)  # -> Geometry, Transform
panel_3 = Panel(move.Geometry)
line = Line(StartPoint=point, EndPoint=move.Geometry)
pipe = Pipe(Curve=line, Radius=Slider(0.945, range=0..1), Caps=1)
