# Grasshopper definition Aula_06_sequencia_de_pilares_base.gh (Grasshopper 1.0.7)

curve = Curve(<curve referenced from the Rhino model>)
python_script = PythonScript(curva1=curve, numP=Slider(11, range=1..50), raio=Slider(0.65, range=0..2), h=Slider(25.02, range=0..100))  # -> out, a; inputs numP: Int32
# ---------- python_script: Python ----------
#Curso de Extensão:
#Lógica de programação aplicada à criação e análise da forma
#UFBa - Faculdade de Arquitetura - 2017.2
#Professor: Fernando Ferraz Ribeiro
#Exemplo Sequencia de pilares
from __future__ import print_function
import rhinoscriptsyntax as rs


# -- Entradas

# curva1 - Curva base para a sequencia de pilares (item, ghdoc)
# numP - Númro de pilres (item, int)
# raio - raio dos pilares (item, float)
# h - altura dos pilares (item, float)
# ---------- end python_script ----------
