# Grasshopper definition Aula_06_sequencia_de_pilares_final.gh (Grasshopper 1.0.7)

curve = Curve(<curve referenced from the Rhino model>)
python_script = PythonScript(curva1=curve, numP=Slider(11, range=1..50), raio=Slider(0.65, range=0..2), h=Slider(25.02, range=0..100))  # -> out, a; inputs numP: Int32
# ---------- python_script: Python ----------
#Curso de Extensão:
#Lógica de programação aplicada à criação e análise da forma
#UFBa - Faculdade de Arquitetura - 2017.2
#Professor: Fernando Ferraz Ribeiro
#Exemplo Sequencia de pilares
from __future__ import print_function
import rhinoscriptsyntax as rs


# -- Entradas

# curva1 - Curva base para a sequencia de pilares (item, ghdoc)
# numP - Númro de pilres (item, int)
# raio - raio dos pilares (item, float)
# h - altura dos pilares (item, float)

#divide a curva1 em um número de segmentos
# o numero de segmentos é dado pela variável inteira numP
pLista = rs.DivideCurve(curva1,numP)

#cria uma lista vazia paraa armazenar os pilares
a = []

for pt in pLista:
    # ponto pt somado a altura h
    pt2 = rs.PointAdd(pt, [0,0,h])
    # linha auxiliar para a o comando pipe
    linAux = rs.AddLine(pt,pt2)
    # Desenhando o tubo com o comando pipe
    tubo = rs.AddPipe(linAux, 0, raio, cap=1)
    # coloca a superfície criana no final da lista a
    a.append(tubo[0])
# ---------- end python_script ----------
