# Grasshopper definition AULA_07_base.gh (Grasshopper 1.0.7)

number_slider = Slider(10, range=0..100)
number_slider_2 = Slider(3.868, range=0..5)
curve = Curve(<curve referenced from the Rhino model>)
curve_2 = Curve(<curve referenced from the Rhino model>)
divide_curve = DivideCurve(Curve=curve, Count=number_slider, Kinks=False)  # -> Points, Tangents, Parameters
curve_3 = Curve(<curve referenced from the Rhino model>)
curve_4 = Curve(<curve referenced from the Rhino model>)
divide_curve_2 = DivideCurve(Curve=curve_2, Count=number_slider, Kinks=False)  # -> Points, Tangents, Parameters
point = Point()
point_2 = Point()
treliça_01_py = PythonScript(C1=curve_3, C2=curve_4, nDiv=Slider(26, range=0..100))  # -> out, teste, Bsup, Diag, Binf, Cordas; inputs nDiv: Int32
# ---------- treliça_01_py: Python ----------
#Curso de Extensão:
#Lógica de programação aplicada à criação e análise da forma
#UFBa - Faculdade de Arquitetura - 2017.2
#Professor: Fernando Ferraz Ribeiro
#Exemplo treliça a partir dos eixos dos banzos
from __future__ import print_function
#Importando Módulos
import rhinoscriptsyntax as rs

#entradas

# --- Entradas:
# C1 - Curva do banzo superior -- (item, ghdoc)
# C2 - Curva do banzo inferior -- (item, ghdoc)
# nDiv - Número de subdivisões dos banzos -- (item, int)


# --- Saidas
teste=[]
Cordas =[]
Diag =[]
Bsup =[]
Binf = []


# --- Função principal
# ---------- end treliça_01_py ----------
number_slider_3 = Slider(0.18, range=0..10)
line = Line(StartPoint=point, EndPoint=point_2)
line_2 = Line(StartPoint=divide_curve.Points, EndPoint=divide_curve_2.Points)
point_list = PointList(Points=divide_curve.Points, Size=number_slider_3)
point_list_2 = PointList(Points=divide_curve_2.Points, Size=number_slider_3)
python_script = PythonScript()  # -> Out, A
