# Grasshopper definition AULA_07_final_2020.gh (Grasshopper 1.0.7)

curve = Curve([<curve referenced from the Rhino model> x2])
loft = Loft(Curves=curve, Options={Adjust=False, Closed=False, LoftEnds=0, LoftSimp=0, LoftType=0, Rebuild=10, Refit=0.01})
divide_surface = DivideSurface(Surface=loft, UCount=Slider(6, range=1..10), VCount=10)  # -> Points, Normals, Parameters
polyline = PolyLine(Vertices=divide_surface.Points, Closed=False)
curve_2 = Curve(<curve referenced from the Rhino model>)
curve_3 = Curve(<curve referenced from the Rhino model>)
ghpython_script = GhPythonScript(c1=polyline, c2=Slider(5.23, range=0..10), nDiv=Slider(21, range=0..50))  # -> out, teste, cordas, diag, bSup, bInf; inputs nDiv: Int32
# ---------- ghpython_script: Python ----------
from __future__ import print_function

import rhinoscriptsyntax as rs

if nDiv is None:
    print (type(nDiv))
    nDiv = 10
    print (type(nDiv))

if type(c2) == float:
    c2 = rs.CopyObject(c1, [0,0,-c2])

# dividin os banzos
listPoint1 = rs.DivideCurve(c1, nDiv)
listPoint2 = rs.DivideCurve(c2, nDiv)

# listas de saida
cordas = []
ptsAux = []

# loop 
for i in range(nDiv+1):
    linAux = rs.AddLine(listPoint2[i], listPoint1[i])
    cordas.append(linAux)
    if i%2 == 0:
        ptsAux.append( listPoint1[i] )
    else:
        ptsAux.append( listPoint2[i] )

diag = rs.AddPolyline(ptsAux)

bSup = rs.AddPolyline(listPoint1)

bInf = rs.AddPolyline(listPoint2)
# ---------- end ghpython_script ----------
panel = Panel(ghpython_script.out)
explode = Explode(Curve=ghpython_script.diag, Recursive=True)  # -> Segments, Vertices
pipe = Pipe(Curve=[ghpython_script.bSup, ghpython_script.bInf], Radius=Slider(0.34, range=0.01..1), Caps=1)
pipe_2 = Pipe(Curve=[explode.Segments, ghpython_script.cordas], Radius=Slider(0.25, range=0.01..1), Caps=1)
