# Grasshopper definition Aula_08 finalRG.gh (Grasshopper 1.0.4)

point = Point(Point(10.94367643, 5.178056256, 0))
rectangular = Rectangular(Plane=PlaneXY(0, 0, 0), SizeX=1, SizeY=2, ExtentX=10, ExtentY=5)  # -> Cells, Points
# Malha de Pontos Vãos Iguais
ghpython_script = GhPythonScript(
    Po=point,
    Dx=Slider(6.43, range=1..21),
    Nx=Slider(7, range=0..20),
    Dy=Slider(9.05, range=0..20),
    Ny=Slider(4, range=0..20))  # -> out, P; inputs Po: Point3d, Nx: Int32, Ny: Int32
# ---------- ghpython_script: Python ----------
import rhinoscriptsyntax as rs
from Rhino.Geometry import Point3d

#saidas   0, 1, 2 .... até x
P = []

if Po is None:
    Po = Point3d(0,0,0)

for x in range(Nx) :
    temp = x*Dx 
    for y in range(Ny):
        tempY = y*Dy
        pTemp = Point3d(temp, tempY, 0) + Po
        P.append(pTemp)
# ---------- end ghpython_script ----------
pt = Point(Point(43.76561957, 54.2132932, 0))
python_malha_de_pontos = PythonScript(O=pt, Dx=Slider(2.9, range=0..10), Nx=Slider(15, range=0..100), Dy=Slider(3.06, range=0..10), Ny=Slider(9, range=0..100))  # -> out, eixosX, eixosY, P; inputs Nx: Int32, Ny: Int32
# ---------- python_malha_de_pontos: Python ----------
#Curso de Extensão:
#Lógica de programação aplicada à criação e análise da forma
#UFBa - Faculdade de Arquitetura - 2017.2
#Professor: Fernando Ferraz Ribeiro
#Exemplo de malha regular de pontos

#importando modulos
import rhinoscriptsyntax as rs



#--- Entradas:
#Dx distância em x dos prontos da malha -- (item, float)
#Nx número de pontos da manha na direção x -- (item, int)
#Dy distância em y dos prontos da malha -- (item, float)
#Ny número de pontos da manha na direção y -- (item, int)



if  O is None:
    O = rs.AddPoint(0,0,0)


# --- Saidas
# Lista de pontos da malha de pilar
P= []

# eixos da manha na direção x
eixosX = []

# eios da malha na direção y
eixosY = []
# ---------- end python_malha_de_pontos ----------
panel = Panel(python_malha_de_pontos.P)
Z = UnitZ(Factor=Slider(10, range=0..10))
# Pilares
pt_2 = Point(python_malha_de_pontos.P)
move = Move(Geometry=pt_2, Motion=Z)  # -> Geometry, Transform
ln = Line(StartPoint=pt_2, EndPoint=move.Geometry)
panel_2 = Panel(move.Geometry)
pipe = Pipe(Curve=ln, Radius=Slider(0.22, range=0..10), Caps="1")
panel_3 = Panel(ln)
panel_4 = Panel(pipe)
