# Grasshopper definition Aula_08 finalRG_Plane.gh (Grasshopper 1.0.7)

curve = Curve(<curve referenced from the Rhino model>)
curve_2 = Curve(<curve referenced from the Rhino model>)
point = Point(Point(-58.44530808, 54.66408608, 0))
line_line = LineLine(LineA=curve_2, LineB=curve)
ghpython_script = GhPythonScript(
    Po=point,
    Dx=Slider(6.43, range=1..21),
    Nx=Slider(7, range=0..20),
    Dy=Slider(9.05, range=0..20),
    Ny=Slider(4, range=0..20))  # -> out, P; inputs Po: Plane, Nx: Int32, Ny: Int32
# ---------- ghpython_script: Python ----------
from __future__ import print_function
import rhinoscriptsyntax as rs
from Rhino.Geometry import Point3d, Vector3d,Plane

#saidas   0, 1, 2 .... até x
P = []


if Po is None:
    Po = Plane(rs.WorldXYPlane())
    
if  rs.IsPoint(Po):
    Po = Plane(rs.MovePlane(rs.WorldXYPlane(),Po))

for x in range(Nx) :
    tempX = x*Dx 
    for y in range(Ny):
        tempY = y*Dy
        pTemp =  Po.XAxis * tempX + Po.YAxis * tempY + Po.Origin
        P.append(pTemp)
# ---------- end ghpython_script ----------
Z = UnitZ(Factor=Slider(10, range=0..10))
# Pilares
pt = Point()
move = Move(Geometry=pt, Motion=Z)  # -> Geometry, Transform
ln = Line(StartPoint=pt, EndPoint=move.Geometry)
panel = Panel(move.Geometry)
pipe = Pipe(Curve=ln, Radius=Slider(0.22, range=0..10), Caps="1")
panel_2 = Panel(ln)
panel_3 = Panel(pipe)
