# Grasshopper definition Aula_08 teste.gh (Grasshopper 1.0.7)

# Malha de Pontos Vãos Variados (por listas)
panel = Panel("""3
3
5
8""")
# Malha de Pontos Vãos Iguais
number_slider = Slider(2.9, range=0..10)
dup = DuplicateData(Data=Slider(3, range=0..10), Number=Slider(8, range=0..100), Order=True)
dup_2 = DuplicateData(Data=Slider(3, range=0..10), Number=Slider(7, range=0..100), Order=True)
pt = Point(Point(43.76561957, 54.2132932, 0))
# MALHA POR LISTAS
pt_2 = Point(<point referenced from the Rhino model>)
ins = InsertItems(List=dup, Item=Slider(4.08, range=0..10), Indices="5", Wrap=True)
python_malha_de_pontos = PythonScript(O=pt, Dx=number_slider, Nx=Slider(15, range=0..100), Dy=Slider(3.06, range=0..10), Ny=Slider(9, range=0..100))  # -> out, Leixos, P; inputs Nx: Int32, Ny: Int32
# ---------- python_malha_de_pontos: Python ----------
#Curso de Extensão:
#Lógica de programação aplicada à criação e análise da forma
#UFBa - Faculdade de Arquitetura - 2017.2
#Professor: Fernando Ferraz Ribeiro
#Exemplo de malha regular de pontos
from __future__ import print_function
#importando modulos
import rhinoscriptsyntax as rs
import itertools


#--- Entradas:
#Dx distância em x dos prontos da malha -- (item, float)
#Nx número de pontos da manha na direção x -- (item, int)
#Dy distância em y dos prontos da malha -- (item, float)
#Ny número de pontos da manha na direção y -- (item, int)



if  O is None:
    O = rs.AddPoint(0,0,0)


# Saidas

P= []
Leixos = []

def flatlist(L):
    res = []
    for i in L:
        if type(i) is list:
            res += flatlist(i)
        else:
            res.append(i)
    return res

Paux=[]
for x in range(Nx):
    LinAux =[]
    for y in range(Ny):
        
        pt = rs.PointAdd(O, [x*Dx, y*Dy, 0])
        LinAux.append(pt)
    eixo = rs.AddLine(LinAux[0], LinAux[-1])
    Leixos.append(eixo)
    Paux.append(LinAux)
    P = P + LinAux
Paux = map(list,itertools.izip_longest(*Paux))


for i in range(Ny):
   
    eixo = rs.AddLine(Paux[i][0], Paux[i][-1])
    Leixos.append(eixo)
# ---------- end python_malha_de_pontos ----------
panel_2 = Panel(ins)
python_malha_vãos = PythonScript(O=pt_2, Lx=panel, Ly=dup)  # -> out, P; inputs Lx: list, Ly: list
# ---------- python_malha_vãos: Python ----------
#----MALHA DE PONTOS
#- o programa gera uma malha de pontos em x,y
# ssa 15 de jul de 2017
from __future__ import print_function
#--- Importando modulos
import rhinoscriptsyntax as rs
 
#--- Entradas:
#O origem da malha -- (item, ghdoc)
#Lx Listas de vãos no sentido x -- (list, float)
#Ly Listas de vãos no sentido y -- (list, float)
# ---------- end python_malha_vãos ----------
flatten = FlattenTree(Tree=python_malha_de_pontos.P, Path="{0}")
panel_3 = Panel(python_malha_vãos.P)
panel_4 = Panel(python_malha_de_pontos.P)
Z = UnitZ(Factor=Slider(10, range=0..10))
# Pilares
pt_3 = Point(python_malha_de_pontos.P)
move = Move(Geometry=pt_3, Motion=Z)  # -> Geometry, Transform
ln = Line(StartPoint=pt_3, EndPoint=move.Geometry)
panel_5 = Panel(move.Geometry)
pipe = Pipe(Curve=ln, Radius=Slider(0.22, range=0..10), Caps="1")
panel_6 = Panel(ln)
panel_7 = Panel(pipe)
