# Grasshopper definition Aula_08.gh (Grasshopper 0.9.76)
# plug-ins: Python Interpreter

# Malha de Pontos Vãos Variados (por listas)
panel = Panel("""3
3
5
8""")
duplicate_data = DuplicateData(Data=Slider(3, range=0..10), Number=Slider(8, range=0..100), Order=True)
duplicate_data_2 = DuplicateData(Data=Slider(3, range=0..10), Number=Slider(7, range=0..100), Order=True)
# Malha de Pontos Vãos Iguais
point = Point(Point(43.76561957, 54.2132932, 0))
insert_items = InsertItems(List=duplicate_data, Item=Slider(4.08, range=0..10), Indices="5", Wrap=True)
# MALHA POR LISTAS
point_2 = Point(<point referenced from the Rhino model>)
python_malha_de_pontos = PythonScript(
    O=point,
    Dx=Slider(3.11, range=0..10),
    Nx=Slider(12, range=0..100),
    Dy=Slider(3.11, range=0..10),
    Ny=Slider(10, range=0..100))  # -> out, Leixos, P; inputs Nx: Int32, Ny: Int32
# ---------- python_malha_de_pontos: Python ----------
#Curso de Extensão:
#Lógica de programação aplicada à criação e análise da forma
#UFBa - Faculdade de Arquitetura - 2017.2
#Professor: Fernando Ferraz Ribeiro
#Exemplo de malha regular de pontos

#importando modulos
import rhinoscriptsyntax as rs
import GhPython as gh

#--- Entradas:
#Dx distância em x dos prontos da malha -- (item, float)
#Nx número de pontos da manha na direção x -- (item, int)
#Dy distância em y dos prontos da malha -- (item, float)
#Ny número de pontos da manha na direção y -- (item, int)

if  O is None:
    O = rs.AddPoint(0,0,0)


#--- Saidas:
# P - lista com os pontos da malha
P = []
Leixos =[]
#--- Função principal:

for i in range(Nx):
    PAux = []
    for j in range(Ny):
        pt = rs.PointAdd( [i*Dx, j*Dy,0], O)
        PAux.append(pt)
    eixo = rs.AddLine(PAux[0],PAux[-1])
    Leixos.append(eixo)
    P = P + PAux
# ---------- end python_malha_de_pontos ----------
panel_2 = Panel(insert_items)
python_malha_vãos = PythonScript(O=point_2, Lx=panel, Ly=duplicate_data)  # -> out, P; inputs Lx: list, Ly: list
# ---------- python_malha_vãos: Python ----------
#----MALHA DE PONTOS
#- o programa gera uma malha de pontos em x,y
# ssa 15 de jul de 2017

#--- Importando modulos
import rhinoscriptsyntax as rs
 
#--- Entradas:
#O origem da malha -- (item, ghdoc)
#Lx Listas de vãos no sentido x -- (list, float)
#Ly Listas de vãos no sentido y -- (list, float)
# ---------- end python_malha_vãos ----------
panel_3 = Panel(python_malha_vãos.P)
unit_z = UnitZ(Factor=Slider(7.47, range=0..10))
# Pilares
point_3 = Point()
move = Move(Geometry=point_3, Motion=unit_z)  # -> Geometry, Transform
line = Line(StartPoint=point_3, EndPoint=move.Geometry)
panel_4 = Panel(move.Geometry)
pipe = Pipe(Curve=line, Radius=Slider(0.22, range=0..10), Caps="1")
panel_5 = Panel(line)
panel_6 = Panel(pipe)
