# Grasshopper definition Aula_08_2018_1.gh (Grasshopper 1.0.7)

# Malha de Pontos Vãos Iguais
number_slider = Slider(3.11, range=0..10)
pt = Point(Point(0, 0, 0))
python_malha_de_pontos = PythonScript(O=pt, Dx=number_slider, Nx=Slider(9, range=0..100), Dy=Slider(3.06, range=0..10), Ny=Slider(9, range=0..100))  # -> out, eixosX, eixosY, P; inputs O: Point3d, Nx: Int32, Ny: Int32
# ---------- python_malha_de_pontos: Python ----------
#Curso de Extensão:
#Lógica de programação aplicada à criação e análise da forma
#UFBa - Faculdade de Arquitetura - 2017.2
#Professor: Fernando Ferraz Ribeiro
#Exemplo de malha regular de pontos
from __future__ import print_function
#importando modulos
import rhinoscriptsyntax as rs
import ghpythonlib.components as ghc



#--- Entradas:
#Dx distância em x dos prontos da malha -- (item, float)
#Nx número de pontos da manha na direção x -- (item, int)
#Dy distância em y dos prontos da malha -- (item, float)
#Ny número de pontos da manha na direção y -- (item, int)



if  O is None:
    O = rs.AddPoint(0,0,0)


# --- Saidas
# Lista de pontos da malha de pilar
P= []

# eixos da manha na direção x
eixosX = []

# eios da malha na direção y
eixosY = []


startX, startY, startZ = O

for x in range(Nx):

    cordX = startX + (x * Dx)
    linY = []
    for y in range(Ny):
        cordY = startY + (y * Dy)
        pTemp = rs.AddPoint([cordX, cordY, startZ])
        linY.append(pTemp)
    eixoYTemp = rs.AddPolyline(linY)
    eixosY.append(eixoYTemp)
    P = P + linY
# ---------- end python_malha_de_pontos ----------
panel = Panel(python_malha_de_pontos.P)
Z = UnitZ(Factor=Slider(10, range=0..10))
# Pilares
pt_2 = Point(python_malha_de_pontos.P)
move = Move(Geometry=python_malha_de_pontos.eixosY, Motion=Z)  # -> Geometry, Transform
move_2 = Move(Geometry=pt_2, Motion=Z)  # -> Geometry, Transform
ln = Line(StartPoint=pt_2, EndPoint=move_2.Geometry)
panel_3 = Panel(move_2.Geometry)
pipe = Pipe(Curve=ln, Radius=Slider(0.22, range=0..10), Caps="1")
panel_4 = Panel(ln)
panel_5 = Panel(pipe)
