# Grasshopper definition Aula_08_final.gh (Grasshopper 1.0.7)

# Malha de Pontos Vãos Iguais
number_slider = Slider(2.9, range=0..10)
pt = Point(Point(43.76561957, 54.2132932, 0))
python_malha_de_pontos = PythonScript(O=pt, Dx=number_slider, Nx=Slider(15, range=0..100), Dy=Slider(3.06, range=0..10), Ny=Slider(9, range=0..100))  # -> out, eixosX, eixosY, P; inputs Nx: Int32, Ny: Int32
# ---------- python_malha_de_pontos: Python ----------
#Curso de Extensão:
#Lógica de programação aplicada à criação e análise da forma
#UFBa - Faculdade de Arquitetura - 2017.2
#Professor: Fernando Ferraz Ribeiro
#Exemplo de malha regular de pontos
from __future__ import print_function
#importando modulos
import rhinoscriptsyntax as rs



# --- Entradas:
#Dx distância em x dos prontos da malha -- (item, float)
#Nx número de pontos da manha na direção x -- (item, int)
#Dy distância em y dos prontos da malha -- (item, float)
#Ny número de pontos da manha na direção y -- (item, int)



if  O is None:
    O = rs.AddPoint(0,0,0)


# --- Saidas

# Lista de pontos da malha de pilar
P= []

# eixos da manha na direção x
eixosX = []

# eios da malha na direção y
eixosY = []


# - Função principal

# lista auxiliar de pontos (sublistas para cada linha y)
Paux=[]

# loop for da dimensão x
for x in range(Nx):
    # lista auxiliar para cada linha de pontos
    LinAux =[]
    
    # loop for na dimensão Y
    for y in range(Ny):
        
        # cria pontos somando valores de coordenadas com a origem
        pt = rs.PointAdd(O, [x*Dx, y*Dy, 0])
        # coloca o ponto na lista auxiliar de linhas
        LinAux.append(pt)
    # coloca a lista linaux como uma sublista na lista Paxu
    Paux.append(LinAux)
    # concatena as listas linaux na lista da saida P
    P = P + LinAux
    
    # eixos no sentido Y
    # desenha uma linha entre os pontos exremos da lista linaux
    eixo = rs.AddLine(LinAux[0], LinAux[-1])
    eixosY.append(eixo)

# Eixos no sentido X
for i in range(Ny):
    
    # desenha loinha de eixo entre os pontos extremos da linha
    eixo = rs.AddLine(Paux[0][i], Paux[-1][i])
    # Coloca o eixo na lista de eixos X
    eixosX.append(eixo)


# --- Fim
# ---------- end python_malha_de_pontos ----------
panel = Panel(python_malha_de_pontos.eixosY)
Z = UnitZ(Factor=Slider(10, range=0..10))
# Pilares
pt_2 = Point(python_malha_de_pontos.P)
move = Move(Geometry=pt_2, Motion=Z)  # -> Geometry, Transform
ln = Line(StartPoint=pt_2, EndPoint=move.Geometry)
panel_2 = Panel(move.Geometry)
pipe = Pipe(Curve=ln, Radius=Slider(0.22, range=0..10), Caps="1")
panel_3 = Panel(ln)
panel_4 = Panel(pipe)
