# Grasshopper definition Aula_08_finalRG.gh (Grasshopper 1.0.7)

point = Point(Point(10.94367643, 5.178056256, 0))
ghpython_script = GhPythonScript(
    Po=point,
    Dx=Slider(8.16, range=1..21),
    Nx=Slider(7, range=0..20),
    Dy=Slider(9.05, range=0..20),
    Ny=Slider(4, range=0..20))  # -> out, P; inputs Po: Point3d, Nx: Int32, Ny: Int32
# ---------- ghpython_script: Python ----------
from __future__ import print_function
import rhinoscriptsyntax as rs
from Rhino.Geometry import Point3d

#saidas   0, 1, 2 .... até x
P = []

if Po is None:
    Po = Point3d(0,0,0)

for x in range(Nx) :
    temp = x*Dx 
    for y in range(Ny):
        tempY = y*Dy
        pTemp = Point3d(temp, tempY, 0) + Po
        P.append(pTemp)
# ---------- end ghpython_script ----------
Z = UnitZ(Factor=Slider(10, range=0..10))
# Pilares
pt = Point(ghpython_script.P)
move = Move(Geometry=pt, Motion=Z)  # -> Geometry, Transform
ln = Line(StartPoint=pt, EndPoint=move.Geometry)
panel = Panel(move.Geometry)
pipe = Pipe(Curve=ln, Radius=Slider(0.22, range=0..10), Caps="1")
panel_2 = Panel(ln)
panel_3 = Panel(pipe)
