# Grasshopper definition malhas_de_pilares_grasshopper.gh (Grasshopper 1.0.7)

panel = Panel("""3.1
7.5
6.25
7.35""")
panel_2 = Panel("""3.1
7.5
6.25
7.35""")
merge = Merge(Data1="0.0", Data2=panel)
merge_2 = Merge(Data1="0.0", Data2=panel_2)
mass_addition = MassAddition(Input=merge_2)  # -> Result, PartialResults
# Malha Irregular
mass_addition_2 = MassAddition(Input=merge)  # -> Result, PartialResults
# Malha regular
series = Series(Start=Slider(0, range=0..100), Step=Slider(3.42, range=0..30), Count=Slider(17, range=0..100))
series_2 = Series(Start=Slider(0, range=0..100), Step=Slider(3.42, range=0..30), Count=Slider(17, range=0..100))
cross_reference = CrossReference(ListListA=mass_addition_2.PartialResults, ListListB=mass_addition.PartialResults, CrossMode=1)  # -> ListListA, ListListB
construct_point = ConstructPoint(XCoordinate=cross_reference.ListListA, YCoordinate=cross_reference.ListListB, ZCoordinate=0)
panel_3 = Panel(series)
cross_reference_2 = CrossReference(ListA=series, ListB=series_2, CrossMode=1)  # -> ListA, ListB
panel_4 = Panel(construct_point)
construct_point_2 = ConstructPoint(XCoordinate=cross_reference_2.ListA, YCoordinate=cross_reference_2.ListB, ZCoordinate=0)
panel_5 = Panel(cross_reference_2.ListB)
panel_6 = Panel(cross_reference_2.ListA)
