# Grasshopper definition Aula_09.gh (Grasshopper 1.0.7)

panel = Panel("""3
6""")
number_slider = Slider(4.8, range=0..100)
duplicate_data = DuplicateData(Data=Slider(4.8, range=0..100), Number=Slider(5, range=0..50), Order=True)
panel_2 = Panel("""4.5
6.75
8""")
insert_items = InsertItems(List=duplicate_data, Item="10.5", Indices=Slider(2, range=0..50), Wrap=True)
duplicate_data_2 = DuplicateData(Data=panel, Number=Slider(5, range=0..50), Order=True)
panel_3 = Panel(duplicate_data)
panel_4 = Panel(insert_items)
python_script_malha_irregular = PythonScript(Lx=insert_items, Ly=panel_2)  # -> out, P; inputs O: Point3d, Lx: list, Ly: list
# ---------- python_script_malha_irregular: Python ----------
from __future__ import print_function
import rhinoscriptsyntax as rs


if O is None:
    O = rs.AddPoint([0,0,0])

# saidas
P =[]

# - função principal

Lx.insert(0,0.0)
Ly.insert(0,0.0)

# zerando variavel antes do loop
xAux = 0
for i in Lx:
    xAux = xAux + i
    # zerando variavel antes do loop
    yAux =0
    for j in Ly:
        #atualizando valor da variável 
        yAux = yAux + j
        print(xAux, yAux, 0)
        pt = rs.PointAdd(O,[xAux, yAux, 0])
        P.append(pt)
# ---------- end python_script_malha_irregular ----------
panel_5 = Panel(duplicate_data_2)
panel_6 = Panel(python_script_malha_irregular.out)
cluster = Cluster(point=python_script_malha_irregular.P)  # -> geometry, pipe_2
panel_7 = Panel(cluster.geometry)
panel_8 = Panel(cluster.pipe_2)

# ==== cluster Cluster
point = ClusterInput()
unit_z = UnitZ(Factor=Slider(7.47, range=0..10))
# Pilares
point_2 = Point(point)
move = Move(Geometry=point_2, Motion=unit_z)  # -> Geometry, Transform
geometry = ClusterOutput(move.Geometry)
line = Line(StartPoint=point_2, EndPoint=move.Geometry)
pipe = Pipe(Curve=line, Radius=Slider(0.22, range=0..10), Caps="1")
panel = Panel(line)
pipe_2 = ClusterOutput(pipe)
