# Grasshopper definition Aula_09_base.gh (Grasshopper 1.0.7)

# Malha de Pontos Vãos Variados (por listas)
panel = Panel("""3
3
5
8""")
duplicate_data = DuplicateData(Data=Slider(3, range=0..10), Number=Slider(8, range=0..100), Order=True)
duplicate_data_2 = DuplicateData(Data=Slider(3, range=0..10), Number=Slider(7, range=0..100), Order=True)
insert_items = InsertItems(List=duplicate_data, Item=Slider(4.08, range=0..10), Indices="5", Wrap=True)
# MALHA POR LISTAS
point = Point(<point referenced from the Rhino model>)
panel_2 = Panel(insert_items)
python_malha_vãos = PythonScript(O=point, Lx=panel, Ly=duplicate_data)  # -> out, P; inputs Lx: list, Ly: list
# ---------- python_malha_vãos: Python ----------
#Curso de Extensão:
#Lógica de programação aplicada à criação e análise da forma
#UFBa - Faculdade de Arquitetura - 2017.2
#Professor: Fernando Ferraz Ribeiro
#Exemplo malha de pontos irregular
from __future__ import print_function
#--- Importando modulos
import rhinoscriptsyntax as rs
 
#--- Entradas:
#O origem da malha -- (item, ghdoc)
#Lx Listas de vãos no sentido x -- (list, float)
#Ly Listas de vãos no sentido y -- (list, float)


if O is None:
    O = rs.AddPoint([0,0,0])

# saidas
P =[]

# - função principal
# ---------- end python_malha_vãos ----------
panel_3 = Panel(python_malha_vãos.P)
unit_z = UnitZ(Factor=Slider(7.47, range=0..10))
# Pilares
point_2 = Point()
move = Move(Geometry=point_2, Motion=unit_z)  # -> Geometry, Transform
line = Line(StartPoint=point_2, EndPoint=move.Geometry)
panel_4 = Panel(move.Geometry)
pipe = Pipe(Curve=line, Radius=Slider(0.22, range=0..10), Caps="1")
panel_5 = Panel(line)
panel_6 = Panel(pipe)
