# Grasshopper definition Aula_09_baseFinal_2019.1.gh (Grasshopper 1.0.7)

xy_plane = XYPlane(Origin=Point(0, 0, 0))
rotate_plane = RotatePlane(Plane=xy_plane, Angle=degrees(Slider(11.5, range=0..360)))
point = Point(Point(10.49976905, 9.2164157, 0))
plane_origin = PlaneOrigin(Base=rotate_plane, Origin=point)
panel = Panel("""3
3
5
10.5""")
# Malha de Pontos Vãos Variados (por listas)
panel_2 = Panel("""3
15
5
8""")
duplicate_data = DuplicateData(Data=Slider(3, range=0..10), Number=Slider(8, range=0..100), Order=True)
duplicate_data_2 = DuplicateData(Data=Slider(3, range=0..10), Number=Slider(7, range=0..100), Order=True)
insert_items = InsertItems(List=duplicate_data, Item=Slider(4.08, range=0..10), Indices="5", Wrap=True)
panel_3 = Panel(insert_items)
# MALHA POR LISTAS
python_malha_vãos = PythonScript(O=plane_origin, Lx=panel_2, Ly=panel)  # -> out, P; inputs O: Plane, Lx: list, Ly: list
# ---------- python_malha_vãos: Python ----------
#Curso de Extensão:
#Lógica de programação aplicada à criação e análise da forma
#UFBa - Faculdade de Arquitetura - 2017.2
#Professor: Fernando Ferraz Ribeiro
#Exemplo malha de pontos irregular
from __future__ import print_function
#--- Importando modulos
import rhinoscriptsyntax as rs
from Rhino.Geometry import Point3d, Vector3d, Plane
 
#--- Entradas:
#O origem da malha -- (item, Plane)
#Lx Listas de vãos no sentido x -- (list, float)
#Ly Listas de vãos no sentido y -- (list, float)


if O is None:
    O = Plane(rs.WorldXYPlane())
if rs.IsPoint(O):
    O = Plane(rs.MovePlane(rs.WorldXYPlane(), O))

# saidas
P =[]

# - função principal
# manipulação de listas
#Inserir valor 0.0 no início de cada lista
#Lx.insert(0, 0.0)
Lx = [0.0] + Lx
Ly.insert(0, 0.0)

tempX = 0
for i in Lx:
    tempX = tempX + i
    tempY = 0
    for j in Ly:
        tempY = tempY + j
        pointAxu = tempX * O.XAxis +  tempY * O.YAxis + O.Origin
        P.append(pointAxu)
# ---------- end python_malha_vãos ----------
panel_4 = Panel(python_malha_vãos.P)
unit_z = UnitZ(Factor=Slider(7.47, range=0..10))
# Pilares
point_2 = Point(python_malha_vãos.P)
move = Move(Geometry=point_2, Motion=unit_z)  # -> Geometry, Transform
line = Line(StartPoint=point_2, EndPoint=move.Geometry)
panel_5 = Panel(move.Geometry)
pipe = Pipe(Curve=line, Radius=Slider(0.22, range=0..10), Caps="1")
panel_6 = Panel(line)
panel_7 = Panel(pipe)
