# Grasshopper definition Aula_09_final.gh (Grasshopper 1.0.7)

number_slider = Slider(4.8, range=0..100)
panel = Panel("""3
6""")
duplicate_data = DuplicateData(Data=Slider(4.8, range=0..100), Number=Slider(5, range=0..50), Order=True)
panel_2 = Panel("""4.5
6.75
8""")
insert_items = InsertItems(List=duplicate_data, Item="10.5", Indices=Slider(2, range=0..50), Wrap=True)
duplicate_data_2 = DuplicateData(Data=panel, Number=Slider(5, range=0..50), Order=True)
panel_3 = Panel(duplicate_data)
panel_4 = Panel(insert_items)
panel_5 = Panel(duplicate_data_2)
python_script_malha_irregular = PythonScript(Lx=insert_items, Ly=panel_2)  # -> out, P; inputs O: Point3d, Lx: list, Ly: list
# ---------- python_script_malha_irregular: Python ----------
#Curso de Extensão:
#Lógica de programação aplicada à criação e análise da forma
#UFBa - Faculdade de Arquitetura - 2017.2
#Professor: Fernando Ferraz Ribeiro
#Exemplo Malha de ponto Irregular
from __future__ import print_function
#--- Importando modulos
import rhinoscriptsyntax as rs
 
#--- Entradas:
#O origem da malha -- (item, ghdoc)
#Lx Listas de vãos no sentido x -- (list, float)
#Ly Listas de vãos no sentido y -- (list, float)


if O is None:
    O = rs.AddPoint([0,0,0])

# saidas
P =[]

# - função principal
# - função principal

Lx.insert(0,0.0)
Ly.insert(0,0.0)

# zerando variavel antes do loop
xAux = 0
for i in Lx:
    xAux = xAux + i
    # zerando variavel antes do loop
    yAux =0
    for j in Ly:
        #atualizando valor da variável 
        yAux = yAux + j
        print (xAux, yAux, 0)
        # cria novo ponto somando com o ponto de origem
        pt = rs.PointAdd(O,[xAux, yAux, 0])
        # coloca o ponto criado na lista de saidas p
        P.append(pt)
# ---------- end python_script_malha_irregular ----------
panel_6 = Panel(python_script_malha_irregular.out)
unit_z = UnitZ(Factor=Slider(7.47, range=0..10))
# Pilares
point = Point(python_script_malha_irregular.P)
move = Move(Geometry=point, Motion=unit_z)  # -> Geometry, Transform
line = Line(StartPoint=point, EndPoint=move.Geometry)
panel_7 = Panel(move.Geometry)
pipe = Pipe(Curve=line, Radius=Slider(0.22, range=0..10), Caps="1")
panel_8 = Panel(line)
panel_9 = Panel(pipe)
