# Grasshopper definition Aula_09_final_RG_teste.gh (Grasshopper 1.0.7)

duplicate_data = DuplicateData(Data=Slider(3, range=0..10), Number=Slider(5, range=0..100), Order=True)
duplicate_data_2 = DuplicateData(Data=Slider(3, range=0..10), Number=Slider(8, range=0..100), Order=True)
# Malha de Pontos Vãos Variados (por listas)
panel = Panel("""2.0
3.0
4.0""")
panel_2 = Panel(duplicate_data_2)
unit_z = UnitZ(Factor=Slider(5.05, range=1..10))
point = Point(Point(7.068589304, 5.157376065, 0))
insert_items = InsertItems(List=duplicate_data_2, Item=Slider(4.08, range=0..10), Indices="5", Wrap=True)
# MALHA POR LISTAS
point_2 = Point(Point(13.27637233, -16.78861541, 0))
move = Move(Geometry=point, Motion=unit_z)  # -> Geometry, Transform
panel_3 = Panel(insert_items)
python_malha_vãos = PythonScript(PL=point_2, Lx=panel, Ly=panel_2)  # -> out, P; inputs PL: Plane, Lx: list, Ly: list
# ---------- python_malha_vãos: Python ----------
#Curso de Extensão:
#Lógica de programação aplicada à criação e análise da forma
#UFBa - Faculdade de Arquitetura - 2017.2
#Professor: Fernando Ferraz Ribeiro
#Exemplo malha de pontos irregular
from __future__ import print_function
#--- Importando modulos
import rhinoscriptsyntax as rs
from Rhino.Geometry import Point3d, Vector3d, Plane
 
#--- Entradas:
#O origem da malha -- (item, Point3d)
#Lx Listas de vãos no sentido x -- (list, float)
#Ly Listas de vãos no sentido y -- (list, float)


if PL is None:
    PL = Plane(Point3d(0,0,0), Vector3d(1,0,0), Vector3d(0,1,0) )
if rs.IsPoint(PL):
    PL = Plane(PL, Vector3d(1,0,0), Vector3d(0,1,0))
PL.Origin
# saidas
P =[]

# - função principal

Lx.insert(0, 0.0)
Ly.insert(0, 0.0)


tempX = 0

for x in range(len(Lx)):
    tempX = tempX + Lx[x]
    tempY = 0
    for y in range(len(Ly)):
        tempY = tempY + Ly[y]
        pTemp = PL.Origin + (tempX * PL.XAxis ) +  (tempY * PL.YAxis)
        P.append(pTemp)
# ---------- end python_malha_vãos ----------
circle = Circle(Plane=point, Radius=Slider(3.64, range=1..10))
number_slider = Slider(26, range=1..100)
panel_4 = Panel(python_malha_vãos.P)
circle_2 = Circle(Plane=move.Geometry, Radius=Slider(3.1, range=1..10))
divide_curve = DivideCurve(Curve=circle_2, Count=number_slider, Kinks=False)  # -> Points, Tangents, Parameters
divide_curve_2 = DivideCurve(Curve=circle, Count=number_slider, Kinks=False)  # -> Points, Tangents, Parameters
shift_list = ShiftList(List=divide_curve_2.Points, Shift=Slider(7, range=1..10), Wrap=True)
panel_5 = Panel(divide_curve.Points)
panel_6 = Panel(divide_curve_2.Points)
line = Line(StartPoint=shift_list, EndPoint=divide_curve.Points)
panel_7 = Panel(shift_list)
unit_z_2 = UnitZ(Factor=Slider(4.03, range=0..10))
# Pilares
point_3 = Point(python_malha_vãos.P)
move_2 = Move(Geometry=point_3, Motion=unit_z_2)  # -> Geometry, Transform
line_2 = Line(StartPoint=point_3, EndPoint=move_2.Geometry)
panel_8 = Panel(move_2.Geometry)
pipe = Pipe(Curve=line_2, Radius=Slider(0.22, range=0..10), Caps="1")
panel_9 = Panel(line_2)
panel_10 = Panel(pipe)
