# Grasshopper definition AULA_10_base_2018.gh (Grasshopper 1.0.7)

number_slider = Slider(0.43, range=0..0.8)
curve = Curve([<curve referenced from the Rhino model> x2])
point = Point(Point(-35.39830031, -28.05879459, 0))
point_2 = Point(Point(25.49004054, 33.16492064, 0))
python_script = PythonScript(
    P2D=point_2,
    P3D=point,
    Contorno=curve,
    PD=Slider(5, range=0..5),
    N_andares=Slider(6, range=0..50),
    Rot=Slider(46.54, range=0..360))  # -> out, Teste, pavConrotno, pavFace, pavLaje; inputs P2D: Plane, P3D: Plane, Contorno: list, N_andares: Int32
# ---------- python_script: Python ----------
#Curso de Extensão:
#Lógica de programação aplicada à criação e análise da forma
#UFBa - Faculdade de Arquitetura - 2018.2
#Professor: Fernando Ferraz Ribeiro
#Exemplo pavimentos multiplos


import rhinoscriptsyntax as rs
from Rhino.Geometry import Point3d, Vector3d, Plane, Point3dGrid


# Tratamento de Entradas
if P2D is None:
    P2D = Plane(Point3d(0,0,0), Vector3d(1,0,0), Vector3d(0,1,0))
if rs.IsPoint(P2D):
    P2D = Plane(P2D, Vector3d(1,0,0), Vector3d(0,1,0))

if P3D is None:
    P3D =  Plane(Point3d(0,0,0), Vector3d(1,0,0), Vector3d(0,1,0))
if rs.IsPoint(P3D):
    P3D = Plane(P3D, Vector3d(1,0,0), Vector3d(0,1,0))

#--- Entradas:
# P2D - ponto no desenho -- (item, Plane)
# P3D - ponto no terreno -- (item, Plane)
# Contorno - contorno da laje -- (list, ghdoc)
# PD - distancia piso a piso-- (item, float)
# h_laje - altura da laje -- (item, float)
# N_andares - Numerod e andares y -- (item, int)
# Rot - rotação dos andares -- (item, float)



#Saidas
# lista de pavimentos
pavConrotno = []
pavFace = []
pavLaje = []
#lista para teste de codigo
Teste = []

#função principal
# ---------- end python_script ----------
panel = Panel(python_script.Teste)
list_item = ListItem(List=python_script.Teste, Index=Slider(35, range=0..50), Wrap=True)
data = Data(python_script.Teste)
vector_display = VectorDisplay(Anchor=point, Vector=list_item)
