# Grasshopper definition AULA_10_final_2018.gh (Grasshopper 1.0.7)

curve = Curve(<curve referenced from the Rhino model>)
point = Point(Point(-35.39830031, -28.05879459, 0))
point_2 = Point(Point(25.49004054, 33.16492064, 0))
python_script = PythonScript(
    P2D=point_2,
    P3D=point,
    Contorno=curve,
    PD=Slider(5, range=0..5),
    N_andares=Slider(6, range=0..50),
    h_laje=Slider(0.43, range=0..0.8),
    Rot=Slider(46.54, range=0..360))  # -> out, Teste, Pav; inputs P2D: Plane, P3D: Plane, Contorno: list, N_andares: Int32
# ---------- python_script: Python ----------
#Curso de Extensão:
#Lógica de programação aplicada à criação e análise da forma
#UFBa - Faculdade de Arquitetura - 2018.2
#Professor: Fernando Ferraz Ribeiro
#Exemplo pavimentos multiplos


import rhinoscriptsyntax as rs
from Rhino.Geometry import Point3d, Vector3d, Plane, Point3dGrid

if P2D is None:
    P2D = Plane(Point3d(0,0,0), Vector3d(1,0,0), Vector3d(0,1,0))
if rs.IsPoint(P2D):
    P2D = Plane(P2D, Vector3d(1,0,0), Vector3d(0,1,0))

if P3D is None:
    P3D =  Plane(Point3d(0,0,0), Vector3d(1,0,0), Vector3d(0,1,0))
if rs.IsPoint(P3D):
    P3D = Plane(P3D, Vector3d(1,0,0), Vector3d(0,1,0))



#--- Entradas:
# P2D - ponto no desenho -- (item, Plane)
# P3D - ponto no terreno -- (item, Plane)
# Contorno - contorno da laje -- (list, ghdoc)
# PD - distancia piso a piso-- (item, float)
# h_laje - altura da laje -- (item, float)
# N_andares - Numerod e andares y -- (item, int)
# Rot - rotação dos andares -- (item, float)



#Saidas
# lista de pavimentos
Pav = []
#lista para teste de codigo
Teste = []

#função principal

# gerando superfície atravès das linhas de contorno
face = rs.AddPlanarSrf(Contorno)
# ponto auxiliar para criaçao da diretriz da extrusão
pAux = P3D.Origin + Point3d( 0,0, h_laje)
# linha diretriz da extrusão
lAux = rs.AddLine(P3D.Origin, pAux)
# sólido gerado pela extrusão
laje = rs.ExtrudeSurface(face, lAux)


# alinhando com o plano P3D
laje = rs.OrientObject(laje, 
[P2D.Origin,  Point3d(P2D.Origin + P2D.XAxis),  Point3d(P2D.Origin + P2D.YAxis)], 
[P3D.Origin, Point3d(P3D.Origin + P3D.XAxis), Point3d(P3D.Origin + P3D.YAxis)])

# loop dos andares
for i in range(N_andares):
    # copiando laje de acordo com o vetor da altura dos pavimentos
    laje_aux = rs.CopyObject(laje, (i * PD *P3D.ZAxis) )
    # dotacionando pavimentos
    laje_aux = rs.RotateObject(laje_aux , P3D.Origin , (Rot * i/N_andares), P3D.ZAxis)
    # colocando laje do pavimento na lista de saida PAV
    Pav.append(laje_aux)
# ---------- end python_script ----------
panel = Panel(python_script.Teste)
list_item = ListItem(List=python_script.Teste, Index=Slider(35, range=0..50), Wrap=True)
data = Data(python_script.Teste)
vector_display = VectorDisplay(Anchor=point, Vector=list_item)
