# Grasshopper definition AULA_10_final_2020.gh (Grasshopper 1.0.7)

curve = Curve([<curve referenced from the Rhino model> x2])
point = Point(Point(20.04528163, 42.18650221, 4.66834355))
point_2 = Point(Point(19.86490965, -38.03756319, 0))
python_script = PythonScript(
    P2D=point_2,
    P3D=point,
    Contorno=curve,
    PD=Slider(3.67, range=0..5),
    N_andares=Slider(26, range=0..50),
    h_laje=Slider(0.43, range=0..0.8),
    Rot=Slider(94.15, range=0..360))  # -> out, Teste, pavConrotno, pavFace, pavLaje; inputs P2D: Plane, P3D: Plane, Contorno: list, N_andares: Int32
# ---------- python_script: Python ----------
#Curso de Extensão:
#Lógica de programação aplicada à criação e análise da forma
#UFBa - Faculdade de Arquitetura - 2018.2
#Professor: Fernando Ferraz Ribeiro
#Exemplo pavimentos multiplos
from __future__ import print_function
import rhinoscriptsyntax as rs
from Rhino.Geometry import Point3d, Vector3d, Plane, Point3dGrid

if P2D is None:
    P2D = Plane(Point3d(0,0,0), Vector3d(1,0,0), Vector3d(0,1,0))


if P3D is None:
    P3D =  Plane(Point3d(0,0,0), Vector3d(1,0,0), Vector3d(0,1,0))

#--- Entradas:
# P2D - ponto no desenho -- (item, Plane)
# P3D - ponto no terreno -- (item, Plane)
# Contorno - contorno da laje -- (list, ghdoc)
# PD - distancia piso a piso-- (item, float)
# h_laje - altura da laje -- (item, float)
# N_andares - Numerod e andares y -- (item, int)
# Rot - rotação dos andares -- (item, float)

#Saidas
# listas de saida
pavConrotno = []
pavFace = []
pavLaje = []

#lista para teste de codigo
Teste = []

#função principal



# alinhando com o plano P3D

ContornoAux =[]


# orinetando os contornos
for curva in Contorno:
    ContornoOrient = rs.OrientObject(curva, 
    [P2D.Origin,  P2D.Origin + P2D.XAxis,  P2D.Origin + P2D.YAxis], 
    [P3D.Origin, P3D.Origin + P3D.XAxis, P3D.Origin + P3D.YAxis])
    ContornoAux.append(ContornoOrient)
    

# loop dos andares
for i in range(N_andares):
    
    #movendo o Contorno para a altura do pavimento
    ContornoMove = rs.CopyObjects(ContornoAux, (i * PD *P3D.ZAxis) )
    
    ## Rotação
    # rotacionando o contorno dos pavimentos
    ContornoMove = rs.RotateObjects(ContornoMove , P3D.Origin , (Rot * i/N_andares), P3D.ZAxis)

    ## saida dos contornos
    # colocando o Contorno movido na lista de saida dos contornos
    pavConrotno  = pavConrotno + ContornoMove
    
    # gerando superfície atravès das linhas de contorno
    face = rs.AddPlanarSrf(ContornoMove)
    
    ## saida das faces
    # colocando a face na lista de saida das faces
    pavFace += face
    
    ## Gerando solidos
    # ponto auxiliar para criaçao da diretriz da extrusão
    pAux = P3D.Origin + Point3d( 0,0, h_laje)
    # linha diretriz da extrusão
    lAux = rs.AddLine(P3D.Origin, pAux)
    # sólido gerado pela extrusão
    laje = rs.ExtrudeSurface(face, lAux)
    # ponto auxiliar para criaçao da diretriz da extrusão
    pAux = P3D.Origin + Point3d( 0,0, h_laje)
    # linha diretriz da extrusão
    lAux = rs.AddLine(P3D.Origin, pAux)
    # sólido gerado pela extrusão
    lajeAux = rs.ExtrudeSurface(face, lAux)
    
    # saida das lajes
    # colocando laje do pavimento na lista de saida PAV
    pavLaje.append(lajeAux)
# ---------- end python_script ----------
panel = Panel(python_script.Teste)
list_item = ListItem(List=python_script.Teste, Index=Slider(35, range=0..50), Wrap=True)
panel_2 = Panel(python_script.pavFace)
vector_display = VectorDisplay(Anchor=point, Vector=list_item)
