# Grasshopper definition AULA_10_final_rh8.gh (Grasshopper 1.0.8)
# plug-ins: RhinoCodePluginGH

point = Point(Point(19.86490965, -38.03756319, 0))
point_2 = Point(Point(20.04528163, 42.18650221, 4.66834355))
curve = Curve([<curve referenced from the Rhino model> x2])
list_length = ListLength(List=curve)
multiplos_pavimentos = Python3Script(
    P2D=point,
    P3D=point_2,
    Contorno=curve,
    PaP=Slider(3.67, range=0..5),
    N_andares=Slider(17, range=0..50),
    h_laje=Slider(0.43, range=0..0.8),
    Rot=Slider(27.47, range=0..360))  # -> out, pavConrotno, pavFace, pavLaje; inputs P2D: Plane, P3D: Plane, Contorno: list, PaP: Double, N_andares: Int32, h_laje: Double, Rot: Double
# ---------- multiplos_pavimentos: Python ----------
# Curso de Extensão:
# Fundamentos de programação aplicada à criação e análise da forma
# Professor: Fernando Ferraz Ribeiro
# Exemplo pavimentos multiplos

import rhinoscriptsyntax as rs
from Rhino.Geometry import Point3d, Vector3d, Plane


if P2D is None:
    P2D = Plane(Point3d(0, 0, 0), Vector3d(1, 0, 0), Vector3d(0, 1, 0))


if P3D is None:
    P3D = Plane(Point3d(0, 0, 0), Vector3d(1, 0, 0), Vector3d(0, 1, 0))

# --- Entradas:
# P2D - ponto no desenho -- (item, Plane)
# P3D - ponto no terreno -- (item, Plane)
# Contorno - contorno da laje -- (list, ghdoc)
# PaP - distancia piso a piso -- (item, float)
# N_andares - Numerod e andares y -- (item, int)
# h_laje - altura da laje -- (item, float)
# Rot - rotação dos andares -- (item, float)

# Saidas
# listas de saida
pavConrotno = []
pavFace = []
pavLaje = []

# lista para teste de codigo
Teste = []

# função principal

# alinhando com o plano P3D
ContornoAux = []

# orinetando os contornos
for curva in Contorno:

    ContornoOrient = rs.OrientObject(curva,
    [P2D.Origin,  P2D.Origin + P2D.XAxis,  P2D.Origin + P2D.YAxis],
    [P3D.Origin, P3D.Origin + P3D.XAxis, P3D.Origin + P3D.YAxis])
    ContornoAux.append(ContornoOrient)

# loop dos andares
for i in range(N_andares +1):

    # Colocando os contornos na posição dos pavimentos

    # movendo o Contorno para a altura do pavimento
    ContornoPos = rs.CopyObjects(ContornoAux, (i * PaP *P3D.ZAxis) )

    # rotacionando o contorno dos pavimentos
    ContornoPos = rs.RotateObjects(ContornoPos , P3D.Origin , (Rot * i/N_andares), P3D.ZAxis)

    # Saida dos contornos
    # colocando o Contorno posicionado na lista de saida dos contornos
    pavConrotno = pavConrotno + ContornoPos

    # Gerando superficie atraves das linhas de contorno
    face = rs.AddPlanarSrf(ContornoPos)

    # Saida das faces
    # colocando a face na lista de saida das faces
    pavFace += face
    # Gerando solidos
    # ponto auxiliar para criaçao da diretriz da extrusão
    pAux = P3D.Origin + Point3d(0, 0, h_laje)
    # linha diretriz da extrusão
    lAux = rs.AddLine(P3D.Origin, pAux)
    # sólido gerado pela extrusão

    lajeAux = rs.ExtrudeSurface(face, lAux)
    # saida das lajes
    # colocando laje do pavimento na lista de saida PAV
    pavLaje.append(lajeAux)
# ---------- end multiplos_pavimentos ----------
subtraction = Subtraction(A=list_length, B="1")
duplicate_data = DuplicateData(Data=Toggle(False), Number=subtraction, Order=True)
panel = Panel(multiplos_pavimentos.pavConrotno)
merge = Merge(Data1=Toggle(True), Data2=duplicate_data)  # -> flatten(Result)
panel_2 = Panel(merge)
panel_3 = Panel(multiplos_pavimentos.pavFace)
dispatch = Dispatch(List=multiplos_pavimentos.pavConrotno, DispatchPattern=merge)  # -> ListA, ListB
panel_4 = Panel(multiplos_pavimentos.pavLaje)
loft = Loft(Curves=dispatch.ListA, Options={Adjust=False, Closed=False, LoftEnds=0, LoftSimp=0, LoftType=0, Rebuild=10, Refit=0.01})
