# Grasshopper definition multi_pav_r8_error.gh (Grasshopper 1.0.8)
# plug-ins: RhinoCodePluginGH

circle = Circle(Plane=PlaneXY(0, 0, 0), Radius=Slider(53.6, range=0..100))
number_slider = Slider(0.14, range=0..0.4)
garagem = Slider(4.13, range=0..10)
térreo = Slider(5.69, range=0..10)
pavtipo = Slider(4.84, range=0..10)
pavtipo_2 = Slider(3.36, range=0..10)
point = Point(Point(52.8164801, 89.42622955, 0))
merge = Merge(Data1=garagem, Data2=térreo, Data3=pavtipo_2, Data4=pavtipo, Data5=pavtipo)
curve = Curve(circle)
point_2 = Point(Point(16.17289723, 25.94855413, 0))
python_script = PythonScript(P2D=point_2, P3D=point, Lista_curvas=curve, Lista_Pap=merge, h_laje=number_slider)  # -> out, lajes, listPlanos; inputs P2D: Plane, P3D: Plane, Lista_curvas: list, Lista_Pap: list
# ---------- python_script: Python ----------
import rhinoscriptsyntax as rs
from Rhino.Geometry import Point3d, Vector3d, Plane

if P2D is None:
    P2D = Plane(Point3d(0,0,0), Vector3d(1,0,0), Vector3d(0,1,0))
if rs.IsPoint(P2D):
    P2D = Plane(P2D,(1,0,0), (0,1,0))

if P3D is None:
    P3D =  Plane(Point3d(0,0,0), Vector3d(1,0,0), Vector3d(0,1,0))
if rs.IsPoint(P3D):
    P3D = Plane(P3D,(1,0,0), (0,1,0))
    
lajes = []

# criando o contorno das lajes
for contorno in Lista_curvas:
    face = rs.AddPlanarSrf (contorno)

    pAux = P3D.Origin + Point3d(0,0,h_laje)
    lAux = rs.AddLine(P3D.Origin, pAux)

    laje = rs.ExtrudeSurface(face, lAux)
    lajes.append(laje)
##função - cia planos em cada nível de pavimentos
def pavIr(PL, Lz, sX = 0.0, sY = 0.0):
    P =[]

    Lz.insert(0, 0.0)
# - mudando a origem x e y do plano
    PL.OriginX = PL.OriginX + sX
    PL.OriginX = PL.OriginX + sY
    
    tempZ = 0
    for z in range(len(Lz)):
        tempZ = tempZ + Lz[z]
        pTemp = PL.Origin + (tempZ *  PL.ZAxis)
        
        pTemp = rs.MovePlane(PL, pTemp)
        P.append(pTemp)
    return P
    
# muda as lajes de plano
def MudaPlano(objeto1, plano1, plano2):
    objeto2 = rs.CopyObject(objeto1)
    objeto2 = rs.OrientObject(objeto2,
    [plano1.Origin,  Point3d(plano1.Origin + plano1.XAxis),  Point3d(plano1.Origin + plano1.YAxis)],
    [plano2.Origin, Point3d(plano2.Origin + plano2.XAxis), Point3d(plano2.Origin + plano2.YAxis)])
    return objeto2

listPlanos = pavIr(P3D, Lista_Pap)

planosExtras = len(listPlanos)  - len(lajes)

if planosExtras > 0:
    lajes = lajes + [lajes[-1]]*planosExtras


for i in range(len(listPlanos)):
    
    lajes[i] = MudaPlano(lajes[i], P2D, listPlanos[i])
# ---------- end python_script ----------
python_3_script = Python3Script(P2D=point_2, P3D=point, Lista_curvas=curve, Lista_Pap=merge, h_laje=number_slider)  # -> out, lajes, listPlanos; inputs P2D: Plane, P3D: Plane, Lista_curvas: list, Lista_Pap: list of Double, h_laje: Double
# ---------- python_3_script: Python ----------
import rhinoscriptsyntax as rs
from Rhino.Geometry import Point3d, Plane


print(type(P3D), "\n", P3D, P3D.IsValid)
print(type(P2D), "\n", P2D, P3D.IsValid)

if not P2D.IsValid:
    P2D = Plane(Point3d(0, 0, 0), Point3d(1, 0, 0), Point3d(0, 1, 0))


if not P3D.IsValid:
    P3D = Plane(Point3d(0, 0, 0), Point3d(1, 0, 0), Point3d(0, 1, 0))


lajes = []

# criando o contorno das lajes
for contorno in Lista_curvas:
    face = rs.AddPlanarSrf(contorno)

    pAux = P3D.Origin + Point3d(0, 0, h_laje)
    lAux = rs.AddLine(P3D.Origin, pAux)

    laje = rs.ExtrudeSurface(face, lAux)
    lajes.append(laje)


# função - cia planos em cada nível de pavimentos
def pavIr(PL, Lz, sX=0.0, sY=0.0):
    P = []
    Lz = [0.0] + Lz

# - mudando a origem x e y do plano
    PL.OriginX = PL.OriginX + sX
    PL.OriginX = PL.OriginX + sY

    tempZ = 0
    for z in range(len(Lz)):
        tempZ = tempZ + Lz[z]
        pTemp = PL.Origin + (tempZ * PL.ZAxis)

        pTemp = rs.MovePlane(PL, pTemp)
        P.append(pTemp)
    return P


# muda as lajes de plano
def MudaPlano(objeto1, plano1, plano2):
    objeto2 = rs.CopyObject(objeto1)
    objeto2 = rs.OrientObject(objeto2,
[plano1.Origin,  plano1.Origin + plano1.XAxis,
    plano1.Origin + plano1.YAxis],
[plano2.Origin, plano2.Origin + plano2.XAxis,
    plano2.Origin + plano2.YAxis],
    1
    )
    return objeto2

listPlanos = pavIr(P3D, Lista_Pap)

planosExtras = len(listPlanos)  - len(lajes)

if planosExtras > 0:
    lajes = lajes + [lajes[-1]]*planosExtras


for i in range(len(listPlanos)):
    
    lajes[i] = MudaPlano(lajes[i], P2D, listPlanos[i])
# ---------- end python_3_script ----------
ironpython_2_script = IronPython2Script(P2D=point_2, Lista_curvas=curve, Lista_Pap=merge, h_laje=number_slider)  # -> out, lajes, listPlanos; inputs P2D: Plane, P3D: Plane, Lista_curvas: list, Lista_Pap: list of Double, h_laje: Double
# ---------- ironpython_2_script: IronPython ----------
import rhinoscriptsyntax as rs
from Rhino.Geometry import Point3d, Vector3d, Plane

if P2D is None:
    P2D = Plane(Point3d(0,0,0), Vector3d(1,0,0), Vector3d(0,1,0))
if rs.IsPoint(P2D):
    P2D = Plane(P2D,(1,0,0), (0,1,0))

if P3D is None:
    P3D =  Plane(Point3d(0,0,0), Vector3d(1,0,0), Vector3d(0,1,0))
if rs.IsPoint(P3D):
    P3D = Plane(P3D,(1,0,0), (0,1,0))
    
lajes = []

# criando o contorno das lajes
for contorno in Lista_curvas:
    face = rs.AddPlanarSrf (contorno)

    pAux = P3D.Origin + Point3d(0,0,h_laje)
    lAux = rs.AddLine(P3D.Origin, pAux)

    laje = rs.ExtrudeSurface(face, lAux)
    lajes.append(laje)
##função - cia planos em cada nível de pavimentos
def pavIr(PL, Lz, sX = 0.0, sY = 0.0):
    P =[]
    Lz = list(Lz)

    Lz = [0.0] + Lz

# - mudando a origem x e y do plano
    PL.OriginX = PL.OriginX + sX
    PL.OriginX = PL.OriginX + sY
    
    tempZ = 0
    for z in range(len(Lz)):
        tempZ = tempZ + Lz[z]
        pTemp = PL.Origin + (tempZ *  PL.ZAxis)
        
        pTemp = rs.MovePlane(PL, pTemp)
        P.append(pTemp)
    return P
    
# muda as lajes de plano
def MudaPlano(objeto1, plano1, plano2):
    objeto2 = rs.CopyObject(objeto1)
    objeto2 = rs.OrientObject(objeto2,
    [plano1.Origin,  Point3d(plano1.Origin + plano1.XAxis),  Point3d(plano1.Origin + plano1.YAxis)],
    [plano2.Origin, Point3d(plano2.Origin + plano2.XAxis), Point3d(plano2.Origin + plano2.YAxis)])
    return objeto2

listPlanos = pavIr(P3D, Lista_Pap)

planosExtras = len(listPlanos)  - len(lajes)

if planosExtras > 0:
    lajes = lajes + [lajes[-1]]*planosExtras


for i in range(len(listPlanos)):
    
    lajes[i] = MudaPlano(lajes[i], P2D, listPlanos[i])
# ---------- end ironpython_2_script ----------
panel = Panel(python_3_script.lajes)
panel_2 = Panel(python_script.lajes)
panel_3 = Panel(python_3_script.out)
panel_4 = Panel(python_script.out)
