# Grasshopper definition teste com escala.gh (Grasshopper 1.0.7)

curve = Curve(<curve referenced from the Rhino model>)
point = Point(Point(20.04528163, 42.18650221, -6.054357785))
point_2 = Point(Point(19.86490965, -38.03756319, 0))
python_script = PythonScript(
    P2D=point_2,
    P3D=point,
    Contorno=curve,
    PD=Slider(3.31, range=0..5),
    N_andares=Slider(26, range=0..50),
    h_laje=Slider(0.43, range=0..0.8),
    Rot=Slider(0, range=0..360),
    sc_val=Slider(0, range=0..10),
    sc_amp=Slider(4.19, range=0..8))  # -> out, Teste, Pav; inputs P2D: Plane, P3D: Plane, Contorno: list, N_andares: Int32
# ---------- python_script: Python ----------
#Curso de Extensão:
#Lógica de programação aplicada à criação e análise da forma
#UFBa - Faculdade de Arquitetura - 2018.2
#Professor: Fernando Ferraz Ribeiro
#Exemplo pavimentos multiplos


import rhinoscriptsyntax as rs
from Rhino.Geometry import Point3d, Vector3d, Plane, Point3dGrid
import math as m

if P2D is None:
    P2D = Plane(Point3d(0,0,0), Vector3d(1,0,0), Vector3d(0,1,0))
if rs.IsPoint(P2D):
    P2D = Plane(P2D, Vector3d(1,0,0), Vector3d(0,1,0))

if P3D is None:
    P3D =  Plane(Point3d(0,0,0), Vector3d(1,0,0), Vector3d(0,1,0))
if rs.IsPoint(P3D):
    P3D = Plane(P3D, Vector3d(1,0,0), Vector3d(0,1,0))

if not sc_amp:
    sc_amp = 1
if not sc_val:
    sc_val = 1

#--- Entradas:
# P2D - ponto no desenho -- (item, Plane)
# P3D - ponto no terreno -- (item, Plane)
# Contorno - contorno da laje -- (list, ghdoc)
# PD - distancia piso a piso-- (item, float)
# h_laje - altura da laje -- (item, float)
# N_andares - Numerod e andares y -- (item, int)
# Rot - rotação dos andares -- (item, float)



#Saidas
# lista de pavimentos
Pav = []
#lista para teste de codigo
Teste = []

#função principal


# ponto auxiliar para criaçao da diretriz da extrusão
pAux = P3D.Origin + Point3d( 0,0, h_laje)
# linha diretriz da extrusão
lAux = rs.AddLine(P3D.Origin, pAux)




# alinhando com o plano P3D
Contorno = rs.OrientObject(Contorno, 
[P2D.Origin,  P2D.Origin + P2D.XAxis,  P2D.Origin + P2D.YAxis], 
[P3D.Origin, P3D.Origin + P3D.XAxis, P3D.Origin + P3D.YAxis])

# loop dos andares
for i in range(N_andares):
    s_aux = abs(m.cos(i*m.pi/(N_andares+1)*sc_amp)) * sc_val +1
    # gerando superfície atravès das linhas de contorno
    face = rs.AddPlanarSrf(Contorno)
    # copiando face de acordo com o vetor da altura dos pavimentos
    cont_aux = rs.CopyObject(face, (i * PD *P3D.ZAxis) )
    # rotacionando as faces
    cont_aux = rs.RotateObject(cont_aux , P3D.Origin , (Rot * i/N_andares), P3D.ZAxis)
    # colocando laje do pavimento na lista de saida PAv
    cont_aux = rs.ScaleObject(cont_aux, P3D.Origin, [s_aux,s_aux,1], copy = False)
    # sólido gerado pela extrusão
    laje = rs.ExtrudeSurface(cont_aux, lAux)
    
    Pav.append(laje)
# ---------- end python_script ----------
panel = Panel(python_script.Teste)
list_item = ListItem(List=python_script.Teste, Index=Slider(35, range=0..50), Wrap=True)
data = Data(python_script.Teste)
vector_display = VectorDisplay(Anchor=point, Vector=list_item)
