# Grasshopper definition AULA_12_final.gh (Grasshopper 1.0.7)

number_slider = Slider(8, range=0..100)
number_slider_2 = Slider(0.45, range=0..1)
number_slider_3 = Slider(0.21, range=0..1)
# Aula 12 -perfis
curve = Curve(<curve referenced from the Rhino model>)
curve_2 = Curve(<curve referenced from the Rhino model>)
# Treliça
treliça_01_py = PythonScript(C1=curve, C2=Slider(2.745, range=0..5), Tipo=Slider(3, range=0..3))  # -> out, Bsup, tgSup, Diag, Binf, tgInf, Cordas; inputs N1: Int32
# ---------- treliça_01_py: Python ----------
#Curso de Extensão:
#Lógica de programação aplicada à criação e análise da forma
#UFBa - Faculdade de Arquitetura - 2017.2
#Professor: Fernando Ferraz Ribeiro
#Exemplo treliça a partir dos eixos dos banzos
from __future__ import print_function
#Importando Módulos
import rhinoscriptsyntax as rs

#entradas

#--- Entradas:
#C1 Curva do banzo superior -- (item, ghdoc)
#C2 Curva do banzo inferior -- (item, ghdoc)
if type(C2) == float:
    C2 = rs.CopyObject(C1,[0,0,-C2])
#N1 Número de subdivisões dos banzos -- (item, int)
if N1 is None:
    N1 = 10


#Saidas

Cordas =[]
Diag =[]
Bsup =[]
Binf = []

## funções:

# recebe uma curva e um inteiro
# retorna duas listas.
# 1. pontos de divisão da curva em N partes;
# 2. Tangentes da curva nos pontos de divisão.

def CurvaDivPtTg(curva, n):
    
    ptos = rs.DivideCurve(curva ,n,  return_points= True)
    
    Params = rs.DivideCurve(curva ,n,  return_points= False)
    tgs = []
    for i in range(len(Params)):
        tgAux = rs.CurveTangent(curva, Params[i])
        tgs.append(tgAux)
    return ptos, tgs


## Gerando lista de pontos

# curva C1
#lista de pontos, lista de tangentes
pontosC1, tgSup = CurvaDivPtTg(C1,N1)


#curva C2
#lista de pontos, lista de tangentes
pontosC2, tgInf = CurvaDivPtTg(C2,N1)


## Banzos Retificados

# funcao polyline desenha uma polyline atravez dos pontos de uma lista
# respeitando a ordem dos indices

# polilinha do banzo C1
Bsup = rs.AddPolyline(pontosC1) 

# polilinha do banzo C2
Binf = rs.AddPolyline(pontosC2)


## desenhando as cordas

# para cada elemento na listas de incices
for i in range(len(pontosC1)):
    # desenhar uma linha entre os pontos de indices correspondente de cada lista
    L1 = rs.AddLine(pontosC1[i], pontosC2[i])
    # colocando elemento na saida Cordas
    Cordas.append(L1)
    
    
## desenhando as diagonais

# criando listas auxiliares vazias apra serem preenchidas durante o for
lAux1 = []
lAux2 =[]


for i in range(len(pontosC1)):
    # se o indice do ponto e par:
    if i%2 == 0:
        # colocar pondo da lista de C1 na lista lAux2, usada para o dessenho...
        # ...da diagonal começando pelo banzo superior
        lAux2.append(pontosC1[i])
        # colocar pondo da lista de C2 na lista lAux1, usada para o dessenho...
        # ...da diagonal começando pelo banzo inferior
        lAux1.append(pontosC2[i])
    else:
        # colocar pondo da lista de C2 na lista lAux2, usada para o dessenho...
        # ...da diagonal começando pelo banzo supeiror
        lAux2.append(pontosC2[i])
        # colocar pondo da lista de C1 na lista lAux1, usada para o dessenho...
        # ...da diagonal começando pelo banzo inferior
        lAux1.append(pontosC1[i])

# colocando as diagonais na lista de saida Diag

## Tipo de Treliça
# a variavel Tipo determina como as diagonais serao desenhadas:
#       0 - não desenha diagonais
#       1 - desenha diagonais começando do banzo inferior
#       2 - desenha diagonais começando no banzo superior
#       3 - desenha diagoanis cruzadas


# se a varíavel tipo não for informada
if Tipo is None:
    Tipo =1
# se tipo == 1
if Tipo == 1:
    # diagonais partindo do banzo inferior (início da lista)
    Diag = rs.AddPolyline(lAux1)
    # se tipo == 2
elif Tipo == 2:
    # diagonais partindo do banzo superior (início da lista)
    Diag = rs.AddPolyline(lAux2)
    # diagonais cruzadas
elif Tipo ==3:
    Diag = [rs.AddPolyline(lAux1), rs.AddPolyline(lAux2)]
    # tipo == 0
elif Tipo == 0:
    # não coloca nada na saida Diag
    pass
# ---------- end treliça_01_py ----------
# Perfis
# Quadrados
perfil_retangular_py = PythonScript(Eixo=treliça_01_py.Diag, Ex=Slider(0.336, range=0..1), Ey=Slider(0.298, range=0..1))  # -> out, Barras; inputs Eixo: Curve
# ---------- perfil_retangular_py: Python ----------
#Curso de Extensão:
#Lógica de programação aplicada à criação e análise da forma
#UFBa - Faculdade de Arquitetura - 2017.1
#Coordenador: Arivaldo Leão de Amorim
#Professor: Fernando Ferraz Ribeiro
#Exemplo: perfis da treliça pelos euxos dos banzos
from __future__ import print_function
#Importando Módulos
import rhinoscriptsyntax as rs

#--- Entradas:
#Eixo -- (item, ghdoc)
#Ex Curva do banzo inferior -- (item, float)
#Ey -- (item, float)


#saidas

# Lista com as barras quadradas
Barras = []

#vetor vertical
vrZ = rs.VectorCreate([0,0,-1], [0,0,0])

normal = rs.CurveTangent(Eixo, 0)

vecBase = rs.VectorCrossProduct(vrZ, normal)

plAux = rs.PlaneFromNormal (rs.CurveStartPoint(Eixo), normal, xaxis=vecBase)


#decompondo o plano
o1, x1, y1, z1 = plAux

#movendo o plano
# vetor auxiliar para mover
vAux = rs.VectorAdd((-Ex/2)*x1, (-Ey/2)*y1)
#novo ponto central
o2 = rs.PointAdd(o1, vAux)
#plano movido
plAux = rs.MovePlane(plAux, o2)

#criando o perfil
perfil = rs.AddRectangle(plAux, Ex, Ey)
# criando o elelento
elemento = rs.AddSweep1(Eixo, [perfil])
#fechando o elelmento
map(rs.CapPlanarHoles,elemento)


#saida das barras
Barras = elemento
# ---------- end perfil_retangular_py ----------
