# Grasshopper definition datatree_examples_py3.gh (Grasshopper 1.0.8)
# plug-ins: RhinoCodePluginGH

panel = Panel("""1
2
3""")
panel_2 = Panel("""a
b
c""")
line = Line(Line((0, 0, 0), (10, 10, 0)))
box = Box({Plane=PlaneXY(-17.38781117, -9.785726393, 0), X=Domain(0, 4.482602728), Y=Domain(0, 4.058462887), Z=Domain(0, 6.765692237)})
panel_3 = Panel("""Default
Layer 01""")
int = Integer(panel)
graft = GraftTree(Tree=panel_2, IncludeEmptyLists=True, IncludeNullItems=True)
graft_2 = GraftTree(Tree=[line, box], IncludeEmptyLists=True, IncludeNullItems=True)
graft_3 = GraftTree(Tree=int, IncludeEmptyLists=True, IncludeNullItems=True)
data = Data([graft, graft_3, graft_2])
python_3_script = Python3Script(layernames=panel_3)  # -> out, a, b; inputs layernames: list
# ---------- python_3_script: Python ----------
import ghpythonlib.treehelpers as th
import Rhino

layerTree = []

for i in range(len(layernames)):
    objs = Rhino.RhinoDoc.ActiveDoc.Objects.FindByLayer(layernames[i])

    if objs:
        geoms = [obj.Geometry for obj in objs]
        layerTree.append(geoms)


layerTreeA = th.list_to_tree(layerTree, source=[0, 0])
a = layerTreeA


layerTreeB = th.list_to_tree(layerTree, source=[1])
b = layerTreeB
# ---------- end python_3_script ----------
panel_4 = Panel(data)
panel_5 = Panel(python_3_script.a)
panel_6 = Panel(python_3_script.b)
explaintree = Python3Script(x=data)  # -> out, a; inputs x: tree
# ---------- explaintree: Python ----------
# (to access gh types - here not needed)
# from Grasshopper.Kernel.Data import GH_Path
# from Grasshopper import DataTree

a = []

for i in range(x.BranchCount):
    branchList = x.Branch(i)
    branchPath = x.Path(i)
    
    for j in range(branchList.Count):
        s = str(branchPath) + "[" + str(j) + "] "
        s += type(branchList[j]).__name__ + ": "
        s += str(branchList[j])
        
        a.append(s)
# ---------- end explaintree ----------
explaintree_th = Python3Script(x=data)  # -> out, a; inputs x: tree
# ---------- explaintree_th: Python ----------
import ghpythonlib.treehelpers as th

x = th.tree_to_list(x)

a = []

for i, branch in enumerate(x):
    
    for j,item in enumerate(branch):
        s = str(i) + "[" + str(j) + "] "
        s += type(item).__name__ + ": "
        s += str(item)
        
        a.append(s)
# ---------- end explaintree_th ----------
panel_7 = Panel(explaintree.a)
panel_8 = Panel(explaintree_th.a)
