# Grasshopper definition Sierpinski3Dbase.gh (Grasshopper 1.0.7)

python_script = PythonScript(Raio=Slider(4.03, range=0..50), iterac=Slider(4, range=0..10))  # -> out, a; inputs iterac: Int32
# ---------- python_script: Python ----------
#Curso de Extensão:
#Lógica de programação aplicada à criação e análise da forma
#UFBa - Faculdade de Arquitetura - 2017.2
#Professor: Fernando Ferraz Ribeiro
#Exemplo: Triângulo de Sierpinski (análogo 3d)

from __future__ import print_function
import rhinoscriptsyntax as rs
from Rhino.Geometry import Point3d, Brep
import ghpythonlib.components as ghcomp


# --- entradas
# raio (item, float)
# iterac (item, int)
# ---------- end python_script ----------
