# Grasshopper definition Escada Piso a Piso e Raios.gh (Grasshopper 0.9.76)
# plug-ins: Python Interpreter

pilar_interno_0_sim_1_não = Slider(0, range=0..1)
raio_externo = Slider(3, range=0..5)
distância_de_piso_a_piso = Slider(6.25, range=0..10)
altura_máxima_espelhos = Slider(0.175, range=0.1..0.3)
altura_da_laje_dos_degraus = Slider(0.1, range=0.1..0.3)
raio_interno = Slider(1, range=0.01..3)
ponto_central_da_escada = Point(Point(0, 0, 0))
numero_de_voltas = Slider(1.5, range=0..5)
rotacão_da_escada = Slider(85, range=0..360)
escada_helicoidal = GhPythonScript(
    PaP=distância_de_piso_a_piso,
    Raio=raio_externo,
    Cen=ponto_central_da_escada,
    EspMax=altura_máxima_espelhos,
    RaioInt=raio_interno,
    hDeg=altura_da_laje_dos_degraus,
    pilar=pilar_interno_0_sim_1_não,
    nVolt=numero_de_voltas,
    rotEsc=rotacão_da_escada)  # -> Escada; inputs Cen: Point3d
# ---------- escada_helicoidal: Python ----------
#Lógica de programação aplicada a arquitetura:
#Docente:
    #Fernando Feraz Ribeiro
#Discentes:
    #Carolina Acaiah Reis dos Santos... carolacaiah@hotmail.com
    #Gabriel Lopes Santana      gabriellopessantana@live.com..
    #Gabrielly  de Almeida Ribeiro Bacelar ... gabybarcelar@gmail.com
#####################################################

#IMPORTANDO BIBLIOTECAS E FUNÇÕES:

import rhinoscriptsyntax as rs
import math as m
from Rhino.Geometry import Point3d

#####################################################

#Entradas:

#pAP = Distância piso a piso
#Raio = Raio externo da escada
#Cen = Centro das circunferências
#EspMax = altura máxima do espelho da escada
#Raioint = Raio do pilar do miolo
#HDeg = altura da "laje do degrau" ou espessura do degrau

#Saida:

Escada=[]

#####################################################

#CALCULO ESCADA:
nEsp = m.ceil(PaP/EspMax)
espR = round(PaP/nEsp , 10)
nEsp1 = int(nEsp)
nPis= nEsp1

#nEsp = Váriavél que contem o numero de espelhos necessarios para vencer a 
#distancia de piso a piso
#espR = altura de cada espelho da escada
#nEsp1 = conversão do numero de espelho de "float" para "inteiro"
#nPis = numero de pisos da escada

#####################################################

#Definindo formato dos degraus:
Cont = rs.AddCircle(Cen,Raio)
ContInt = rs.AddCircle(Cen,RaioInt)

#Cont = Circulo do contorno da escada
#ContIn = Circulo do pilar da escada

#####################################################

#Aplicando trim as curvas para formar o contorno do degrau:

Contorno = []

Dom = rs.CurveDomain(Cont)
Dom[1] /= nPis/nVolt
Contorno.append(rs.TrimCurve( Cont, Dom))

Dom2 = rs.CurveDomain (ContInt)
Dom2[1] /= nPis/nVolt
Contorno.append(rs.TrimCurve (ContInt, Dom2, delete_input=False))

#####################################################

#Criando superfie do degrau a partir das linhas do contorno:

SupDeg = rs.AddEdgeSrf(Contorno)
zAux1 = Cen.Z + espR
pAux1 = Point3d(Cen.X, Cen.Y,zAux1)
vecAux1 = rs.VectorCreate(pAux1,Cen)
SupDeg = rs.MoveObject(SupDeg,vecAux1)


#Extrudando superficie para formar degrau:

pDeg = rs.PointAdd ([0,0,hDeg],Cen)
lDeg = rs.AddLine (pDeg,Cen)
Degrau = rs.ExtrudeSurface(SupDeg,lDeg)

#pDeg = Ponto auxiliar para criar direção e altura da extrusão
#lDeg = linha com altura e direção da extrusão
#Degrau = sólido do degrau


#Copiando degrau nas alturas dos pisos:

conjDeg = []


nvolt = 360*nVolt
rot=nvolt/nPis

for i in range(nPis):
    zAux = Cen.Z + (i * espR)
    pAux = Point3d(Cen.X, Cen.Y,zAux)
    vecAux = rs.VectorCreate(pAux,Cen)
    degAux = rs.CopyObject(Degrau,vecAux)
    degAux = rs.RotateObject(degAux,Cen,rot*i)
    Escada.append(degAux)



#Criando pilar interno da escada:

if pilar == 0:
    pPil = rs.PointAdd (Cen, [0,0,PaP])
    lPil = rs.AddLine (Cen, pPil)
    supPil = rs.AddPlanarSrf (ContInt)
    Pil = rs.ExtrudeSurface(supPil,lPil)
    Escada.append(Pil)

rs.RotateObject(Escada,Cen,rotEsc)
# ---------- end escada_helicoidal ----------
